# Grasshopper definition shoe_box_energy_model.gh (Grasshopper 1.0.7)

# ---- group: Dynamically Chage Glazing Ratio
number_slider = Slider(4, range=1..9, expression="x * 0.1")

# ----
# Create Honeybee Model
panel = Panel("outdoors")
geo = Geometry([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])
geo_2 = Geometry(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)
face = HBFace(geo=geo, bc=panel)  # -> report, faces; plug-in component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
face_2 = HBFace(geo=geo_2, bc="adiabatic")  # -> report, faces; plug-in component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
aperturesbyratio = HBAperturesByRatio(hb_objs=flatten(face.faces), ratio=number_slider)  # -> report, hb_objs; plug-in component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
all_air = HBAllAirHVACTemplates({"VAV chiller with gas boiler reheat": "VAV_Chiller_Boiler", "VAV chiller with central air source heat pump reheat": "VAV_Chiller_ASHP", "VAV chiller with district hot water reheat": "VAV_Chiller_DHW", "VAV chiller with PFP boxes": "VAV_Chiller_PFP", "VAV chiller with gas coil reheat": "VAV_Chiller_GasCoil", "VAV air-cooled chiller with gas boiler reheat": "VAV_ACChiller_Boiler", "VAV air-cooled chiller with central air source heat pump reheat": "VAV_ACChiller_ASHP", "VAV air-cooled chiller with district hot water reheat": "VAV_ACChiller_DHW", "VAV air-cooled chiller with PFP boxes": "VAV_ACChiller_PFP", "VAV air-cooled chiller with gas coil reheat": "VAV_ACChiller_GasCoil"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}, selected="VAV chiller with gas boiler reheat")
room = HBRoom(
    faces=flatten([face_2.faces, aperturesbyratio.hb_objs]),
    name="Office Shoe Box",
    constr_set="2019::ClimateZone5::SteelFramed",
    program="2019::LargeOffice::OpenOffice",
    conditioned=True)  # -> report, room; plug-in component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
concat = Concatenate(FragmentA="ShoeBox", FragmentB=number_slider)
allairhvac = HBAllAirHVAC(rooms=flatten(room.room), system_type=all_air, name="VAV System", economizer="DifferentialDryBulb")  # -> report, rooms; plug-in component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
daylightcontrol = HBApplyDaylightControl(rooms=flatten(allairhvac.rooms))  # -> report, rooms; plug-in component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
model = HBModel(rooms=flatten(daylightcontrol.rooms), name=concat)  # -> report, model; plug-in component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

# ----
# Request Outputs
bldgvintages = HBBuildingVintages({"ASHRAE 90.1 2019  |  IECC 2021": "2019", "ASHRAE 90.1 2016  |  IECC 2018": "2016", "ASHRAE 90.1 2013  |  IECC 2015": "2013", "ASHRAE 90.1 2010  |  IECC 2012": "2010", "ASHRAE 90.1 2007  |  IECC 2009": "2007", "ASHRAE 90.1 2004  |  IECC 2006": "2004", "1980-2004 (CBECS)": "1980_2004", "Pre-1980 (CBECS)": "pre_1980"}, selected="ASHRAE 90.1 2019  |  IECC 2021")
toggle = BooleanToggle(True)
simoutput = HBSimulationOutput(zone_energy_use=toggle, system_energy_use=toggle)  # -> report, sim_output; plug-in component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
sizingpar = HBSizingParameter(eff_standard=bldgvintages)  # -> sizing; plug-in component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
simpar = HBSimulationParameter(output=simoutput.sim_output, timestep=6, sizing=sizingpar)  # -> sim_par; plug-in component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

# ----
# Download EPW File
panel_2 = Panel("https://energyplus-weather.s3.amazonaws.com/north_and_central_america_wmo_region_4/USA/MA/USA_MA_Boston-Logan.Intl.AP.725090_TMY3/USA_MA_Boston-Logan.Intl.AP.725090_TMY3.zip")
downloadepw = LBDownloadWeather(weather_URL=panel_2)  # -> epw_file, stat_file, ddy_file; plug-in component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

toggle_2 = BooleanToggle(False)
modeltoosm = HBModelToOSM(model=model.model, epw_file=downloadepw.epw_file, sim_par=simpar, write=toggle_2, run=toggle_2)  # -> report, jsons, osw, osm, idf, sql, zsz, rdd, html; plug-in component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

# ----
# Compute EUI
eui = HBEndUseIntensity(sql=modeltoosm.sql)  # -> eui, eui_end_use, end_uses, gross_floor; plug-in component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
eui_kwh_m2 = Panel(eui.eui)
panel_3 = Panel(eui.eui_end_use)
panel_4 = Panel(eui.end_uses)
